% Simulink data dictionary ParametersSystemCodegen.sldd

BIT_MASK_ADD_LED = "0x40"
BIT_MASK_BOTH_LEDS = "0x60"
BIT_MASK_COINS_FLAP = "0x80"
BIT_MASK_GREEN_BUTTON = "0x01"
BIT_MASK_RED_BUTTON = "0x02"
BIT_MASK_RETURN_LED = "0x20"
DISPLAY_1 = uint8(1)
DISPLAY_2 = uint8(2)
DISPLAY_3 = uint8(3)
DisplayValue = Simulink.Signal(DataType="int32", Dimensions=[1 3], InitialValue="[ ]")
MINUS_VALUE = Simulink.Signal(DataType="uint8", Min=45, Max=45, InitialValue="45")
BIT_MASK_COINS_FLAP_NOT = "0x7F"
BIT_MASK_BOTH_LEDS_NOT = "0x9F"
INT_CASE_ENTRY_9 = Simulink.Signal(DataType="uint8", Min=9, Max=9, InitialValue="9")
INT_CASE_ENTRY_0 = Simulink.Signal(DataType="uint8", Min=0, Max=0, InitialValue="0")
INT_CASE_ENTRY_M = Simulink.Signal(DataType="uint8", Min=45, Max=45, InitialValue="45")
INT_CASE_ENTRY_8 = Simulink.Signal(DataType="uint8", Min=8, Max=8, InitialValue="8")
INT_CASE_ENTRY_7 = Simulink.Signal(DataType="uint8", Min=7, Max=7, InitialValue="7")
INT_CASE_ENTRY_6 = Simulink.Signal(DataType="uint8", Min=6, Max=6, InitialValue="6")
INT_CASE_ENTRY_5 = Simulink.Signal(DataType="uint8", Min=5, Max=5, InitialValue="5")
INT_CASE_ENTRY_4 = Simulink.Signal(DataType="uint8", Min=4, Max=4, InitialValue="4")
INT_CASE_ENTRY_3 = Simulink.Signal(DataType="uint8", Min=3, Max=3, InitialValue="3")
INT_CASE_ENTRY_2 = Simulink.Signal(DataType="uint8", Min=2, Max=2, InitialValue="2")
INT_CASE_ENTRY_1 = Simulink.Signal(DataType="uint8", Min=1, Max=1, InitialValue="uint8(1)")
SEGMENTS_DIGIT_P = Simulink.Signal(DataType="uint8", InitialValue="char2dec('0b10000000')")
SEGMENTS_DIGIT_M = Simulink.Signal(DataType="uint8", InitialValue="char2dec('0b01000000')")
SEGMENTS_DIGIT_E = Simulink.Signal(DataType="uint8", InitialValue="char2dec('0b00000000')")
SEGMENTS_DIGIT_9 = Simulink.Signal(DataType="uint8", InitialValue="char2dec('0b01101111')")
SEGMENTS_DIGIT_8 = Simulink.Signal(DataType="uint8", InitialValue="char2dec('0b01111111')")
SEGMENTS_DIGIT_7 = Simulink.Signal(DataType="uint8", InitialValue="char2dec('0b00000111')")
SEGMENTS_DIGIT_6 = Simulink.Signal(DataType="uint8", InitialValue="char2dec('0b01111101')")
SEGMENTS_DIGIT_5 = Simulink.Signal(DataType="uint8", InitialValue="char2dec('0b01101101')")
SEGMENTS_DIGIT_4 = Simulink.Signal(DataType="uint8", InitialValue="char2dec('0b01100110')")
SEGMENTS_DIGIT_3 = Simulink.Signal(DataType="uint8", InitialValue="char2dec('0b01001111')")
SEGMENTS_DIGIT_2 = Simulink.Signal(DataType="uint8", InitialValue="char2dec('0b01011011')")
SEGMENTS_DIGIT_1 = Simulink.Signal(DataType="uint8", InitialValue="char2dec('0b00000110')")
SEGMENTS_DIGIT_0 = Simulink.Signal(DataType="uint8", InitialValue="char2dec('0b00111111')")
INTEGER_010_CENTS = uint8(10)
INTEGER_020_CENTS = uint8(20)
INTEGER_050_CENTS = uint8(50)
INTEGER_100_CENTS = uint8(100)
INTEGER_200_CENTS = uint8(200)
INT_MASK_010_CENTS = Simulink.Signal(DataType="uint8", Min=1, Max=1, InitialValue="1")
INT_MASK_020_CENTS = Simulink.Signal(DataType="uint8", Min=2, Max=2, InitialValue="2")
INT_MASK_050_CENTS = Simulink.Signal(DataType="uint8", Min=4, Max=4, InitialValue="4")
INT_MASK_100_CENTS = Simulink.Signal(DataType="uint8", Min=8, Max=8, InitialValue="8")
INT_VAL_010_CENTS = Simulink.Signal(DataType="int32", Min=10, Max=10, InitialValue="10")
INT_VAL_020_CENTS = Simulink.Signal(DataType="int32", Min=20, Max=20, InitialValue="20")
INT_VAL_050_CENTS = Simulink.Signal(DataType="int32", Min=50, Max=50, InitialValue="50")
INT_VAL_100_CENTS = Simulink.Signal(DataType="int32", Min=100, Max=100, InitialValue="100")
BIT_MASK_010_CENTS = "0x01"
BIT_MASK_020_CENTS = "0x02"
BIT_MASK_050_CENTS = "0x04"
BIT_MASK_100_CENTS = "0x08"
BIT_MASK_200_CENTS = "0x10"
INT_MASK_PRINT_TICKET = Simulink.Signal(DataType="uint8", InitialValue="16")
TICKET_FEE = Simulink.Signal(DataType="uint16", Min=120, Max=120, InitialValue="120")
BIT_MASK_MASTER_SWITCH = "0x04"
SRC = Simulink.Variant(Condition="C_INTERFACE == 0")
MEX = Simulink.Variant(Condition="C_INTERFACE == 1")
INTEGER_000_CENTS = uint8(0)
DISPLAY_REGISTER_1 = "0xA000"
DISPLAY_REGISTER_2 = "0xA001"
DISPLAY_REGISTER_3 = "0xA002"
INSERTED_COINS_REGISTER = "0xA011"
PERIPHERALS_REGISTER = "0xA003"
AVAILABLE_COINS_REGISTER = "0xA012"
BUTTONS_REGISTER = "0xA010"
REFRESHING_TIME = Simulink.Signal(DataType="double", Min=0.015, Max=0.05, InitialValue="0.050")
C_INTERFACE = 0

InputsBus = Simulink.Bus()
  green_pressed: boolean
  red_pressed: boolean
  master_switch: boolean
  coins_reg_value: uint8
  temp_amount: uint8

OutputsBus = Simulink.Bus()
  flap_open: boolean
  edge_pulse: boolean
  return_value: uint8
  display_value: uint8[1 3]
  register_value: uint8

EventsBus = Simulink.Bus()
  ISR_0: boolean
  ISR_1: boolean
  ISR_2: boolean
  ISR_3: boolean
  ISR_4: boolean
  ISR_5: boolean
  ISR_6: boolean

SAMPLING_PULSE = 0.15
PULSE_DURATION = Simulink.Signal(DataType="double", Min=0.05, Max=0.15, InitialValue="0.05")
SAMPLING_TIME = 0.0025